# Grasshopper definition SFmaker_FREE_v3_demo_01.gh (Grasshopper 1.0.7)
# Copyright: LA
# plug-ins: Ambrosinus Toolkit

number_slider = Slider(2, range=0..100)
number_slider_2 = Slider(1234, range=0..3000)
la_snowmakfree = SnowflakesMaker(Thickness=1.5, Seed=42)  # -> Curves, Surface, HangPt, DNACode, Info
la_atk_buymeacoffee = ATkSupportBuyMeACoffee()
crv = Curve(la_snowmakfree.Curves)
srf = Surface(la_snowmakfree.Surface)
pt = Point(la_snowmakfree.HangPt)
panel = Panel(la_snowmakfree.DNACode)
panel_2 = Panel(la_snowmakfree.Info)
swatch = ColourSwatch(SwatchColor=RGB(255, 255, 255))

# ---- group: Parametric Hang
cluster = Cluster(C=crv, B=srf, G=pt, A=Slider(-1.24, range=-5..5), num=Slider(3.45, range=0..30), F=Slider(1.9, range=0..30))

# ----
la_setcanvas = SetCanvas(
    CustomCanvas=Toggle(False),
    CanvasBack=ColourSwatch(SwatchColor=RGB(199, 115, 115)),
    CanvasGrid=ColourSwatch(SwatchColor=RGB(107, 107, 107)),
    CustomPnl=False,
    PnlBack=RGB(255, 255, 255),
    CustomWire=False,
    WireStart=RGB(255, 255, 255),
    WireEnd=RGB(255, 255, 255),
    CustomComp=False,
    CompBody=RGB(255, 255, 255),
    CompEdge=RGB(255, 255, 255),
    CompText=RGB(255, 255, 255),
    CompCore=RGB(255, 255, 255))
preview = CustomPreview(Geometry=cluster, Material=ColourSwatch(SwatchColor=RGB(179, 197, 199)))

# ==== cluster Cluster
C = ClusterInput()
B = ClusterInput()
G = ClusterInput()
A = ClusterInput()
num = ClusterInput()
F = ClusterInput()
bbox = BoundingBox(Content=C, Plane=PlaneXY(0, 0, 0), UnionBox=True)  # -> Box, Box_2
area = Area(Geometry=bbox.Box)  # -> Area, Centroid
num_2 = Number(num)
eval = Evaluate(F="Sqrt(A/π)", A=area.Area)
Y = UnitY(Factor=1)
line = LineSDL(Start=area.Centroid, Direction=Y, Length=eval)
amp = Amplitude(Vector=line, Amplitude=A)
move = Move(Geometry=G, Motion=amp)  # -> Geometry, Transform
cir = Circle(Plane=move.Geometry, Radius=num_2)
amp_2 = Amplitude(Vector=line, Amplitude=num_2)
move_2 = Move(Geometry=cir, Motion=amp_2)  # -> Geometry, Transform
number_slider = Slider(8, range=0..30)
division = Division(A=num_2, B=2)
offset = OffsetCurve(Curve=move_2.Geometry, Distance=expr("-x", division), Corners=1)
Z = UnitZ(Factor=F)
loft = Loft(
    Curves=flatten([move_2.Geometry, offset]),
    Options={Adjust=False, Closed=False, LoftEnds=0, LoftSimp=0, LoftType=0, Rebuild=10, Refit=0.01})
extr = Extrude(Base=B, Direction=Z)
extr_2 = Extrude(Base=loft, Direction=Z)
merge = Merge(Data1=extr_2, Data2=extr)  # -> flatten(Result)
R = ClusterOutput(merge)
